# Grasshopper definition pipeline.gh (Grasshopper 1.0.7)
# plug-ins: LadybugGrasshopper

plus = Panel("10")
minus = Panel("10")
X = Panel("8.5")
Y = Panel("-10.5")
Z = Panel("50")
positionersecondaryangle = Slider(-12.7, range=-40..40)
positionerprimaryangle = Slider(17, range=-100..60)
addition = Addition(A=Z, B=plus)
addition_2 = Addition(A=Y, B=plus)
subtraction = Subtraction(A=Y, B=minus)
y_direction = ConstructPoint(XCoordinate=X, YCoordinate=addition_2, ZCoordinate=Z)
y_direction_2 = ConstructPoint(XCoordinate=X, YCoordinate=subtraction, ZCoordinate=Z)
adjustable_isocenter = ConstructPoint(XCoordinate=X, YCoordinate=Y, ZCoordinate=Z)
z_direction = ConstructPoint(XCoordinate=X, YCoordinate=Y, ZCoordinate=addition)
radians = Radians(Degrees=positionerprimaryangle)
radians_2 = Radians(Degrees=positionersecondaryangle)
vector_z = Vector2Pt(PointA=adjustable_isocenter, PointB=z_direction, Unitize=False)  # -> Vector, Length
vector_y = Vector2Pt(PointA=adjustable_isocenter, PointB=y_direction, Unitize=False)  # -> Vector, Length
vector_y_2 = Vector2Pt(PointA=adjustable_isocenter, PointB=y_direction_2, Unitize=False)  # -> Vector, Length
isocenter = Point(adjustable_isocenter)
primary_rotate = Rotate(Vector=vector_y_2.Vector, AlongAxis=vector_z.Vector, Angle=radians)
xy_plane = PlaneNormal(Origin=adjustable_isocenter, ZAxis=vector_z.Vector)
xz_plane = PlaneNormal(Origin=adjustable_isocenter, ZAxis=vector_y.Vector)
width = Panel("10")
get_endpoint = Addition(Origin=isocenter, Vector=primary_rotate)
primary_rotation_vector = VectorDisplayEx(Point=adjustable_isocenter, Vector=primary_rotate, Colour=ColourSwatch(SwatchColor=RGB(4, 0, 250)), Width=width)
isocenter_2 = Point(adjustable_isocenter)
ypz_plane = Plane3Pt(PointA=adjustable_isocenter, PointB=get_endpoint, PointC=z_direction)
deconstruct_plane = DeconstructPlane(Plane=ypz_plane)  # -> Origin, XAxis, YAxis, ZAxis
secondary_rotate = Rotate(Vector=primary_rotate, Axis=deconstruct_plane.ZAxis, Angle=radians_2)
colour_swatch = ColourSwatch(SwatchColor=RGB(250, 0, 0))
vector_display = VectorDisplay(Anchor=isocenter, Vector=deconstruct_plane.ZAxis)
visua_plane_origin = PlaneNormal(Origin=isocenter_2, ZAxis=secondary_rotate)
get_endpoint_2 = Addition(Origin=isocenter, Vector=secondary_rotate)
secondary_vector_display = VectorDisplayEx(Point=adjustable_isocenter, Vector=secondary_rotate, Colour=colour_swatch, Width=width)
vector_light = Vector2Pt(PointA=get_endpoint_2, PointB=isocenter_2, Unitize=False)  # -> Vector, Length
# Setting Up Receive Screen
vector_display_ex = VectorDisplayEx(Point=isocenter_2, Colour=colour_swatch, Width=width)  # disabled

panel = Panel(radians)
panel_2 = Panel(radians_2)
lb_imageviewer = LBImageViewer(ImagePath_=<missing>, _scale_=1, DisableClickable=False, SaveImgWithCoords=False, scale=1)  # -> ImagePath, Values, GIF; disabled
radius = Slider(0.65, range=0..3.14)
# Vessels Structures
colour_swatch_2 = ColourSwatch(SwatchColor=RGB(255, 0, 0))

effect_region = Slider(0.03, range=0..0.2)
position = Slider(0.52, range=0..1)
severity = Slider(0.73, range=0..1)
boolean_toggle = BooleanToggle(True)
gene_pool = GenePool(Decimals=2, Maximum=1.2, Minimum=0, Value=[0.62, 0.46, 0.45, 0.21])
gene_pool_2 = GenePool(Decimals=2, Maximum=1.2, Minimum=0, Value=[0.75, 0.61, 0.51, 0.21])
gene_pool_3 = GenePool(Decimals=2, Maximum=1, Minimum=0, Value=[0, 0.3, 0.62, 1])
gene_pool_4 = GenePool(Decimals=2, Maximum=1.2, Minimum=0, Value=[0.78, 0.69, 0, 0.21])
main_branch = Curve(reparameterize(<curve referenced from the Rhino model>))
stnosis_generator = GhPythonScript(stenosis_point=position, effect_region=effect_region, percentage=severity)  # -> positions_param, positions_radii
# ---------- stnosis_generator: Python ----------
__author__ = "gaozj"
__version__ = "2021.09.07"

import rhinoscriptsyntax as rs

baseline_radii = [1.8, 1.6, 1.5, 1.45, 1.4, 1.35, 1.3, 1.25, 1.1, 0.9, 0.7, 0.5, 0.3]

def get_radii(target_point, positions, baseline_radii):
    for index, pos in enumerate(positions):
        if pos <= target_point < positions[index+1]:
            relative_indice = (index, index+1)
            ref_position = positions[index:index+2]
            ref_radii = baseline_radii[index:index+2]
    target_radii = ref_radii[0] - (target_point - ref_position[0])*(ref_radii[0] - ref_radii[1])/(ref_position[1] - ref_position[0])
    return target_radii

def generate_stenosis(baseline_radii, stenosis_point, effect_region, percentage):
    ref_point = len(baseline_radii)
    positions_prep = list(range(0,ref_point,1))
    positions = [round(i/(ref_point-1),2) for i in positions_prep]
    
    stenosis_region_start = stenosis_point - effect_region
    stenosis_region_end = stenosis_point + effect_region
    
    # Obtain the indice of the reference points that fall into the stenosis range
    indice_within_region = []
    # Obtain the indice of the reference points that closest to the stenosis point
    for index, pos in enumerate(positions):
        if stenosis_region_start <= pos <= stenosis_region_end:
            indice_within_region.append(index)
        if pos <= stenosis_point < positions[index+1]:
            stenosis_relative_indices = (index, index+1)
            
    # print(indice_within_region)
    start_radii = round(get_radii(stenosis_region_start, positions, baseline_radii),2)
    stenosis_radii = round((1-percentage)*get_radii(stenosis_point, positions, baseline_radii),2)
    end_radii = round(get_radii(stenosis_region_end, positions, baseline_radii),2)

    if len(indice_within_region) == 0:
        # None of the original reference points fall into the stenosis region, 
        # to create a stenosis, add three additional reference points to the 
        # point list at the position of the stenosis_relative_indices
        ref_index = stenosis_relative_indices[1]
        positions[ref_index:ref_index] = [stenosis_region_start, stenosis_point, stenosis_region_end]   
        baseline_radii[ref_index:ref_index] = [start_radii, stenosis_radii, end_radii]
    else:
        # One or more of the original reference points fall into the stenosis region, 
        # replace them with the stenosis region reference points
        positions[min(indice_within_region):max(indice_within_region)+1] = [stenosis_region_start, stenosis_point, stenosis_region_end]
        baseline_radii[min(indice_within_region):max(indice_within_region)+1] = [start_radii, stenosis_radii, end_radii]
    positions_out = [round(position,2) for position in positions]
    return positions_out, baseline_radii

positions_param, positions_radii = generate_stenosis(baseline_radii, stenosis_point, effect_region, percentage)
# ---------- end stnosis_generator ----------
curve = Curve(reparameterize(<curve referenced from the Rhino model>))
curve_2 = Curve(reparameterize(<curve referenced from the Rhino model>))
curve_3 = Curve(reparameterize(<curve referenced from the Rhino model>))
curve_4 = Curve(reparameterize(<curve referenced from the Rhino model>))
curve_5 = Curve(reparameterize(<curve referenced from the Rhino model>))

# ----
# Setting up Angulation
heartmovement = GhPythonScript(curveObject=main_branch, random_t=radius)  # -> updateCurve; inputs curveObject: Curve
# ---------- heartmovement: Python ----------
__author__ = "zijung"
__version__ = "2021.10.29"

import rhinoscriptsyntax as rs
import Rhino
import math
import random

ISOCENTER = (8.5, -10.5, 50)

def DivideCurve(curveObject, segmentNum, return_points=True):
    """Helper function customized from the following link
    https://github.com/mcneel/rhinoscriptsyntax/blob/rhino-6.x/Scripts/rhinoscript/curve.py
    Divides a curve object into a specified number of segments.
    Inputs:
      curveObject: <Rhino.Geometry.Curve> the curve object to be divided
      segmentNum: <python int> The number of segments.
      return_points: <python bool, optional> If omitted or True, points are returned.
          If False, then a list of curve parameters are returned.
    Returns:
      list(point|number, ...): If `return_points` is not specified or True, then a list containing 3D division points.
      list(point|number, ...): If `return_points` is False, then an array containing division curve parameters.
      None: if not successful, or on error.
    """
    # curveParams are the division curve parameters 
    curveParams = curveObject.DivideByCount(segmentNum, True)
    if return_points:
        dividedPoints = [curveObject.PointAt(t) for t in curveParams]
        return dividedPoints
    return curveParams

def HeartMovementGenerator(curveObject, random_time, min_scale=0.9, max_scale=1.1):
    """
    Generate twists of vessel centerline to mimic the effect heart movements
    Pseudo Code
        input: time from $0$ to $pi$, the isocenter
        for points on a polyline
            calculate the `distance` between a point and the isocenter
            form a `vector` from isocenter to point
            extend the `vector` by a `distance` factor and a time (cos) factor
            obtain the `endpoint` and add to newpoints
        reconstruct a polyline based on newpoints  
    Inputs:
        min_scale <python float>, the minimum adjust scale
        max_scale <python float>, the maximum adjust scale
    """
    # random_time = random.uniform(0, math.pi)
    far = 58.1465
    near = 30.8165
    minDistance = math.floor(near)
    maxDistance = math.ceil(far)
    med_value = round((minDistance/maxDistance +1)/2,2)
    print(med_value)
    sign = lambda x: (1, -1)[x<1]
    adjust_func = lambda x, y: math.e**(sign(y)*(med_value-x))
    isocenter = Rhino.Geometry.Point3d(ISOCENTER[0], ISOCENTER[1], ISOCENTER[2])
    scale_range = max_scale - min_scale
    dividedPoints = DivideCurve(curveObject, segmentNum=80)
    rescaledPoints = []
    for pointObject in dividedPoints:
        dist = isocenter.DistanceTo(pointObject)
        scale_factor = min_scale + math.sin(random_time)*scale_range
        # scale_factor is a value in range (min_scale, max_scale)
        adjust_factor = scale_factor*(adjust_func(dist/maxDistance, scale_factor))
        print(adjust_factor, dist, scale_factor)
        ptVector = (pointObject - isocenter)*adjust_factor
        adjust_endpoint = isocenter + ptVector
        # print(pointObject.X, pointObject.Y, pointObject.Z)
        # print(adjust_endpoint.X, adjust_endpoint.Y, adjust_endpoint.Z)
        rescaledPoints.append(adjust_endpoint)

    updateCurve = Rhino.Geometry.Curve.CreateControlPointCurve(rescaledPoints)
    domain = Rhino.Geometry.Interval(0, 1)
    updateCurve.Domain = domain
    return updateCurve
    
updateCurve = HeartMovementGenerator(curveObject, random_t)
# ---------- end heartmovement ----------
heartmovement_2 = GhPythonScript(curveObject=curve_5, random_t=radius)  # -> updateCurve; inputs curveObject: Curve
# ---------- heartmovement_2: Python ----------
__author__ = "zijung"
__version__ = "2021.10.29"

import rhinoscriptsyntax as rs
import Rhino
import math
import random

ISOCENTER = (8.5, -10.5, 50)

def DivideCurve(curveObject, segmentNum, return_points=True):
    """Helper function customized from the following link
    https://github.com/mcneel/rhinoscriptsyntax/blob/rhino-6.x/Scripts/rhinoscript/curve.py
    Divides a curve object into a specified number of segments.
    Inputs:
      curveObject: <Rhino.Geometry.Curve> the curve object to be divided
      segmentNum: <python int> The number of segments.
      return_points: <python bool, optional> If omitted or True, points are returned.
          If False, then a list of curve parameters are returned.
    Returns:
      list(point|number, ...): If `return_points` is not specified or True, then a list containing 3D division points.
      list(point|number, ...): If `return_points` is False, then an array containing division curve parameters.
      None: if not successful, or on error.
    """
    # curveParams are the division curve parameters 
    curveParams = curveObject.DivideByCount(segmentNum, True)
    if return_points:
        dividedPoints = [curveObject.PointAt(t) for t in curveParams]
        return dividedPoints
    return curveParams

def HeartMovementGenerator(curveObject, random_time, min_scale=0.9, max_scale=1.1):
    """
    Generate twists of vessel centerline to mimic the effect heart movements
    Pseudo Code
        input: time from $0$ to $pi$, the isocenter
        for points on a polyline
            calculate the `distance` between a point and the isocenter
            form a `vector` from isocenter to point
            extend the `vector` by a `distance` factor and a time (cos) factor
            obtain the `endpoint` and add to newpoints
        reconstruct a polyline based on newpoints  
    Inputs:
        min_scale <python float>, the minimum adjust scale
        max_scale <python float>, the maximum adjust scale
    """
    # random_time = random.uniform(0, math.pi)
    far = 58.1465
    near = 30.8165
    minDistance = math.floor(near)
    maxDistance = math.ceil(far)
    sign = lambda x: (1, -1)[x<1]
    adjust_func = lambda x, y: 3**(sign(y)*(0.8-x))
    isocenter = Rhino.Geometry.Point3d(ISOCENTER[0], ISOCENTER[1], ISOCENTER[2])
    scale_range = max_scale - min_scale
    dividedPoints = DivideCurve(curveObject, segmentNum=80)
    rescaledPoints = []
    for pointObject in dividedPoints:
        dist = isocenter.DistanceTo(pointObject)
        scale_factor = min_scale + math.sin(random_time)*scale_range
        # scale_factor is a value in range (min_scale, max_scale)
        adjust_factor = scale_factor*(adjust_func(dist/maxDistance, scale_factor))
        print(adjust_factor, dist, scale_factor)
        ptVector = (pointObject - isocenter)*scale_factor
        adjust_endpoint = isocenter + ptVector
        # print(pointObject.X, pointObject.Y, pointObject.Z)
        # print(adjust_endpoint.X, adjust_endpoint.Y, adjust_endpoint.Z)
        rescaledPoints.append(adjust_endpoint)

    updateCurve = Rhino.Geometry.Curve.CreateControlPointCurve(rescaledPoints)
    domain = Rhino.Geometry.Interval(0, 1)
    updateCurve.Domain = domain
    return updateCurve
    
updateCurve = HeartMovementGenerator(curveObject, random_t)
# ---------- end heartmovement_2 ----------
heartmovement_3 = GhPythonScript(curveObject=curve_3, random_t=radius)  # -> updateCurve; inputs curveObject: Curve; same code as heartmovement_2
heartmovement_4 = GhPythonScript(curveObject=curve_2, random_t=radius)  # -> updateCurve; inputs curveObject: Curve; same code as heartmovement_2
heartmovement_5 = GhPythonScript(curveObject=curve_4, random_t=radius)  # -> updateCurve; inputs curveObject: Curve
# ---------- heartmovement_5: Python ----------
__author__ = "zijung"
__version__ = "2021.10.29"

import rhinoscriptsyntax as rs
import Rhino
import math
import random

ISOCENTER = (8.5, -10.5, 50)

def DivideCurve(curveObject, segmentNum, return_points=True):
    """Helper function customized from the following link
    https://github.com/mcneel/rhinoscriptsyntax/blob/rhino-6.x/Scripts/rhinoscript/curve.py
    Divides a curve object into a specified number of segments.
    Inputs:
      curveObject: <Rhino.Geometry.Curve> the curve object to be divided
      segmentNum: <python int> The number of segments.
      return_points: <python bool, optional> If omitted or True, points are returned.
          If False, then a list of curve parameters are returned.
    Returns:
      list(point|number, ...): If `return_points` is not specified or True, then a list containing 3D division points.
      list(point|number, ...): If `return_points` is False, then an array containing division curve parameters.
      None: if not successful, or on error.
    """
    # curveParams are the division curve parameters 
    curveParams = curveObject.DivideByCount(segmentNum, True)
    if return_points:
        dividedPoints = [curveObject.PointAt(t) for t in curveParams]
        return dividedPoints
    return curveParams

def HeartMovementGenerator(curveObject, random_time, min_scale=0.9, max_scale=1.1):
    """
    Generate twists of vessel centerline to mimic the effect heart movements
    Pseudo Code
        input: time from $0$ to $pi$, the isocenter
        for points on a polyline
            calculate the `distance` between a point and the isocenter
            form a `vector` from isocenter to point
            extend the `vector` by a `distance` factor and a time (cos) factor
            obtain the `endpoint` and add to newpoints
        reconstruct a polyline based on newpoints  
    Inputs:
        min_scale <python float>, the minimum adjust scale
        max_scale <python float>, the maximum adjust scale
    """
    # random_time = random.uniform(0, math.pi)
    far = 58.1465
    near = 30.8165
    minDistance = math.floor(near)
    maxDistance = math.ceil(far)
    sign = lambda x: (1, -1)[x<1]
    adjust_func = lambda x, y: 2**(sign(y)*(0.8-x))
    isocenter = Rhino.Geometry.Point3d(ISOCENTER[0], ISOCENTER[1], ISOCENTER[2])
    scale_range = max_scale - min_scale
    dividedPoints = DivideCurve(curveObject, segmentNum=80)
    rescaledPoints = []
    for pointObject in dividedPoints:
        dist = isocenter.DistanceTo(pointObject)
        scale_factor = min_scale + math.sin(random_time)*scale_range
        # scale_factor is a value in range (min_scale, max_scale)
        adjust_factor = scale_factor*(adjust_func(dist/maxDistance, scale_factor))
        print(adjust_factor, dist, scale_factor)
        ptVector = (pointObject - isocenter)*adjust_factor
        adjust_endpoint = isocenter + ptVector
        # print(pointObject.X, pointObject.Y, pointObject.Z)
        # print(adjust_endpoint.X, adjust_endpoint.Y, adjust_endpoint.Z)
        rescaledPoints.append(adjust_endpoint)

    updateCurve = Rhino.Geometry.Curve.CreateControlPointCurve(rescaledPoints)
    domain = Rhino.Geometry.Interval(0, 1)
    updateCurve.Domain = domain
    return updateCurve
    
updateCurve = HeartMovementGenerator(curveObject, random_t)
# ---------- end heartmovement_5 ----------
heartmovement_6 = GhPythonScript(curveObject=curve, random_t=radius)  # -> updateCurve; inputs curveObject: Curve; same code as heartmovement_2
major_vessel = PipeVariable(
    Curve=heartmovement,
    Parameters=stnosis_generator.positions_param,
    Radii=stnosis_generator.positions_radii,
    Caps=boolean_toggle)
mesh_brep = MeshBrep(
    Brep=major_vessel,
    Settings={GridMaxCount=0, GridMinCount=16, JaggedSeams=False, MaxEdgeLength=0, MinEdgeLength=0.0001, MinTolerance=0, Refine=True, RefineAngle=0, RelativeTolerance=0.65, SimplePlanes=True, Tolerance=0})
custom_preview = CustomPreview(Geometry=mesh_brep, Material=colour_swatch_2)

sub_branch_blue = PipeVariable(Curve=heartmovement_6, Parameters=gene_pool_3, Radii=gene_pool, Caps=boolean_toggle)
sub_branch_green = PipeVariable(Curve=heartmovement_4, Parameters=gene_pool_3, Radii=gene_pool_4, Caps=boolean_toggle)
sub_branch_purple = PipeVariable(Curve=heartmovement_3, Parameters=gene_pool_3, Radii=gene_pool_2, Caps=boolean_toggle)
sub_branch_yellow = PipeVariable(Curve=heartmovement_2, Parameters=gene_pool_3, Radii=gene_pool_2, Caps=boolean_toggle)
major_vessel_2 = PipeVariable(
    Curve=heartmovement,
    Parameters=stnosis_generator.positions_param,
    Radii=stnosis_generator.positions_radii,
    Caps=boolean_toggle)
sub_branch_light_blue = PipeVariable(Curve=heartmovement_5, Parameters=gene_pool_3, Radii=gene_pool_4, Caps=boolean_toggle)
split_brep = SplitBrep(Brep=sub_branch_blue, Cutter=major_vessel_2)
split_brep_2 = SplitBrep(Brep=sub_branch_light_blue, Cutter=major_vessel_2)
split_brep_3 = SplitBrep(Brep=sub_branch_green, Cutter=major_vessel_2)
split_brep_4 = SplitBrep(Brep=sub_branch_purple, Cutter=major_vessel_2)
split_brep_5 = SplitBrep(Brep=sub_branch_yellow, Cutter=major_vessel_2)
dispatch = Dispatch(List=split_brep, DispatchPattern=[True, False])  # -> ListA, ListB
dispatch_2 = Dispatch(List=split_brep_2, DispatchPattern=[True, False])  # -> ListA, ListB
dispatch_3 = Dispatch(List=split_brep_5, DispatchPattern=[True, False])  # -> ListA, ListB
dispatch_4 = Dispatch(List=split_brep_4, DispatchPattern=[True, False])  # -> ListA, ListB
dispatch_5 = Dispatch(List=split_brep_3, DispatchPattern=[True, False])  # -> ListA, ListB
brep = Brep(dispatch_3.ListA)
brep_2 = Brep(dispatch_2.ListA)
brep_3 = Brep(dispatch_5.ListA)
brep_4 = Brep(dispatch.ListA)
brep_5 = Brep(dispatch_4.ListA)
mesh_brep_2 = MeshBrep(
    Brep=major_vessel_2,
    Settings={GridMaxCount=0, GridMinCount=16, JaggedSeams=False, MaxEdgeLength=0, MinEdgeLength=0.0001, MinTolerance=0, Refine=True, RefineAngle=0, RelativeTolerance=0.65, SimplePlanes=True, Tolerance=0})
mesh_brep_3 = MeshBrep(
    Brep=brep_5,
    Settings={GridMaxCount=0, GridMinCount=16, JaggedSeams=False, MaxEdgeLength=0, MinEdgeLength=0.0001, MinTolerance=0, Refine=True, RefineAngle=0, RelativeTolerance=0.65, SimplePlanes=True, Tolerance=0})
mesh_brep_4 = MeshBrep(
    Brep=brep_3,
    Settings={GridMaxCount=0, GridMinCount=16, JaggedSeams=False, MaxEdgeLength=0, MinEdgeLength=0.0001, MinTolerance=0, Refine=True, RefineAngle=0, RelativeTolerance=0.65, SimplePlanes=True, Tolerance=0})
mesh_brep_5 = MeshBrep(
    Brep=brep_2,
    Settings={GridMaxCount=0, GridMinCount=16, JaggedSeams=False, MaxEdgeLength=0, MinEdgeLength=0.0001, MinTolerance=0, Refine=True, RefineAngle=0, RelativeTolerance=0.65, SimplePlanes=True, Tolerance=0})
mesh_brep_6 = MeshBrep(
    Brep=brep,
    Settings={GridMaxCount=0, GridMinCount=16, JaggedSeams=False, MaxEdgeLength=0, MinEdgeLength=0.0001, MinTolerance=0, Refine=True, RefineAngle=0, RelativeTolerance=0.65, SimplePlanes=True, Tolerance=0})
mesh_brep_7 = MeshBrep(
    Brep=brep_4,
    Settings={GridMaxCount=0, GridMinCount=16, JaggedSeams=False, MaxEdgeLength=0, MinEdgeLength=0.0001, MinTolerance=0, Refine=True, RefineAngle=0, RelativeTolerance=0.65, SimplePlanes=True, Tolerance=0})
custom_preview_2 = CustomPreview(Geometry=mesh_brep_2, Material=ColourSwatch(SwatchColor=RGB(242, 31, 105)))
custom_preview_3 = CustomPreview(Geometry=mesh_brep_5, Material=ColourSwatch(SwatchColor=RGB(31, 214, 242)))
custom_preview_4 = CustomPreview(Geometry=mesh_brep_6, Material=ColourSwatch(SwatchColor=RGB(239, 242, 31)))
custom_preview_5 = CustomPreview(Geometry=mesh_brep_3, Material=ColourSwatch(SwatchColor=RGB(179, 31, 242)))
custom_preview_6 = CustomPreview(Geometry=mesh_brep_4, Material=ColourSwatch(SwatchColor=RGB(42, 250, 0)))
custom_preview_7 = CustomPreview(Geometry=mesh_brep_7, Material=ColourSwatch(SwatchColor=RGB(0, 46, 250)))

merge = Merge(Data1=mesh_brep_2, Data2=mesh_brep_5, Data3=mesh_brep_6, Data4=mesh_brep_3, Data5=mesh_brep_4, Data6=mesh_brep_7)

distancesourcetodetector = Slider(1108.19, range=800..1400)
distancesourcetopatient = Slider(942.1, range=600..1200)
plane_size = Slider(118, range=0..200)
subtraction_2 = Subtraction(A=distancesourcetopatient, B=distancesourcetodetector)
receive_plane = PlaneOffset(BasePlane=visua_plane_origin, Offset=subtraction_2)
deconstruct_plane_2 = DeconstructPlane(Plane=receive_plane)  # -> Origin, XAxis, YAxis, ZAxis
uncenter_receive_screen = PlaneSurface(Plane=receive_plane, XSize=plane_size, YSize=plane_size)
receive_screen_center = PolygonCenter(Polyline=uncenter_receive_screen)  # -> CenterV, CenterE, CenterA
line = Line(StartPoint=deconstruct_plane_2.Origin, EndPoint=receive_screen_center.CenterV)
point2vector = Vector2Pt(PointA=receive_screen_center.CenterV, TargetPt=deconstruct_plane_2.Origin, Unitize=False)  # -> Vector, Length
move = Move(Geometry=uncenter_receive_screen, Motion=point2vector.Vector)  # -> Geometry, Transform
colour_swatch_3 = ColourSwatch(SwatchColor=RGB(255, 255, 255))

control_points = ControlPoints(Curve=main_branch)  # -> graft(Points), Weights, Knots
width_2 = Panel("100")
deconstruct = Deconstruct(Point=control_points.Points)  # -> XComponent, YComponent, ZComponent
list_item = ListItem(List=flatten(control_points.Points), Index=Slider(1, range=-1..1), Wrap=True)
multiplication = Multiplication(A=width_2, B=position)
merge_2 = Merge(Data1=deconstruct.XComponent, Data2=deconstruct.YComponent, Data3=deconstruct.ZComponent)
the_first_point = Point(list_item)
integer = Integer(multiplication)
panel_3 = Panel(merge_2)
sphere = Sphere(Base=the_first_point, Radius=Slider(0.736, range=0..1))
divide_curve = DivideCurve(Curve=main_branch, Count=width_2, Kinks=False)  # -> Points, Tangents, Parameters
list_item_2 = ListItem(List=divide_curve.Points, Index=integer, Wrap=True)
stnosis_point = Point(list_item_2)
sphere_2 = Sphere(Base=stnosis_point, Radius=Slider(1, range=0..1))
# Mark Important Points
pull_point = PullPoint(Point=divide_curve.Points, Geometry=move.Geometry, ClosestOnly=True)  # -> graft(ClosestPoint), Distance
panel_4 = Panel(pull_point.ClosestPoint)

z_direction_2 = Multiplication(A=deconstruct_plane_2.ZAxis, B=Slider(-1, range=-1..1))
unit_vector = UnitVector(Vector=z_direction_2)
division = Division(A=distancesourcetodetector, B=Slider(6, range=1..10))
adjust_vec_cam_d_to_obj = Multiplication(A=division, B=unit_vector)
x_direction = Multiplication(A=deconstruct_plane_2.XAxis, B=Slider(0, range=-1..1))
camera_point = Subtraction(Origin=deconstruct_plane_2.Origin, Vector=adjust_vec_cam_d_to_obj)
# Setting Up Camera
vector_display_2 = VectorDisplay(Anchor=camera_point, Vector=adjust_vec_cam_d_to_obj)
set_view = GhPythonScript(position=camera_point, direction=adjust_vec_cam_d_to_obj, view_name="Perspective", up_direction=x_direction)  # -> out
# ---------- set_view: Python ----------
"""
Reset Rhino's Perspective view based on given Camera location
and veiw direction.
    Inputs:
        view_name: the name of the view
        _position: Rhino 3D point, position of a camera 
        _direction: A Rhino vector that will be used to set the direction of view
    Output:
        out: The name of the view
"""

__author__ = "gaozj"
__version__ = "2021.09.13"

import rhinoscriptsyntax as rs
import Rhino.Geometry as rg
from ladybug_rhino.viewport import viewport_by_name

def set_view(view_name, _direction, _position, _up_direction):
    # import scriptcontext as sc
    # view_port = sc.doc.Views.Find(view_name, False).ActiveViewport
    view_port = viewport_by_name(view_name)
    view_port.SetCameraTarget(rg.Point3d.Add(rs.coerce3dpoint(_position), _direction), False)
    view_port.SetCameraDirection(_direction, False)
    view_port.SetCameraLocation(rs.coerce3dpoint(_position), False)
    view_port.CameraUp = _up_direction
    print(view_name)

set_view(view_name, _direction, _position,_up_direction)
rs.ViewDisplayMode(rs.CurrentView(),"Shaded")

# rs.Command("-_Shade _View=_Active Selected=No DisplayMode=Shaded DrawCurves=No DrawWires=No DrawGrid=No DrawAxes=No _Enter _Enter", True)
#import rhinoscriptsyntax as rs
#import scriptcontext as sc
#import Rhino as rc
#
#sc.doc = rc.RhinoDoc.ActiveDoc
#rs.CurrentView(view = View2Save)
#rs.AddNamedView(ViewName, View2Save)
#sc.doc = ghdoc
# ---------- end set_view ----------
panel_5 = Panel("C://Users//gaozj//Desktop//Angio//SyntheticAngio//save_image//")
run = BooleanToggle(True)
run_2 = BooleanToggle(True)
captureview = LBCaptureView(file_name="Perspective", folder=panel_5, viewport=set_view, transparent=run, capture=run_2)  # -> Output; plug-in component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
lb_imageviewer_2 = LBImageViewer(ImagePath_=captureview, _scale_=1, DisableClickable=False, SaveImgWithCoords=False, scale=1)  # -> ImagePath, Values, GIF

mesh_shadow = MeshShadow(Mesh=mesh_brep_2, Light=vector_light.Vector, Plane=receive_plane)
mesh_shadow_2 = MeshShadow(Mesh=mesh_brep_5, Light=vector_light.Vector, Plane=receive_plane)
mesh_shadow_3 = MeshShadow(Mesh=mesh_brep_6, Light=vector_light.Vector, Plane=receive_plane)
mesh_shadow_4 = MeshShadow(Mesh=mesh_brep_3, Light=vector_light.Vector, Plane=receive_plane)
mesh_shadow_5 = MeshShadow(Mesh=mesh_brep_4, Light=vector_light.Vector, Plane=receive_plane)
mesh_shadow_6 = MeshShadow(Mesh=mesh_brep_7, Light=vector_light.Vector, Plane=receive_plane)

random_line = Line(line)

curve_6 = Curve(mesh_shadow)
colour_swatch_4 = ColourSwatch(SwatchColor=RGB(0, 0, 0))
gradient_hatch = GradientHatch(Boundaries=curve_6, Axis=random_line, Colour1=colour_swatch_4, Colour2=colour_swatch_4)
contour = Contour(
    Shape=mesh_brep_2,
    Point=deconstruct_plane_2.Origin,
    Direction=deconstruct_plane_2.ZAxis,
    Distance=Slider(0.15, range=0..8))
colour_swatch_5 = ColourSwatch(SwatchColor=RGBA(0, 0, 0, 14))
pull_to_screen = PullCurve(Curve=contour, Surface=move.Geometry)
gradient_hatch_2 = GradientHatch(Boundaries=pull_to_screen, Axis=random_line, Colour1=colour_swatch_5, Colour2=colour_swatch_5)

panel_6 = Panel(x_direction)
move_2 = Move(Geometry=move.Geometry, Motion=z_direction_2)  # -> Geometry, Transform
# Projection of Vessel Structure on Screen
merge_outlines = Merge(
    Data1=mesh_shadow,
    Data2=mesh_shadow_2,
    Data3=mesh_shadow_3,
    Data4=mesh_shadow_4,
    Data5=mesh_shadow_5,
    Data6=mesh_shadow_6)

gradient_hatch_3 = GradientHatch(Boundaries=move_2.Geometry, Axis=line, Colour1=colour_swatch_3, Colour2=colour_swatch_3)
